# Grasshopper definition FoundObjects-EdgeGenerator.gh (Grasshopper 1.0.7)

# Nested Parts
geo = Geometry()
# Sheet Outline
geo_2 = Geometry()
max_width = Slider(70, range=0..100)
concave_corners = Slider(0, range=0..2)
convex_corners = Slider(0, range=0..2)
offset = Slider(6, range=0..10)
cluster = Cluster(
    offset=offset,
    min_width=Slider(11, range=0..100),
    dis=max_width,
    parts=geo,
    sheet_outline=geo_2,
    cf=concave_corners,
    cf_2=convex_corners,
    min_length=Slider(176, range=0..1000))

# ==== cluster Cluster
parts = ClusterInput()
cluster = Footprint(G=parts)
sheet_outline = ClusterInput()
dis = ClusterInput()
polyboolean = PolylineBoolean(
    A=sheet_outline,
    B=cluster,
    BooleanType=2,
    Plane=Plane(origin=(0, 0, 0), x=(0, 0, 0), y=(0, 0, 0)),
    Tolerance=0.01,
    EvenOdd=True)
offset = ClusterInput()
min_width = ClusterInput()
cf = ClusterInput()
cf_2 = ClusterInput()
rec = Rectangle(sheet_outline)
min_length = ClusterInput()

neg = Negative(Value=dis)
offset_2 = OffsetCurve(Curve=sheet_outline, Distance=neg, Corners=1)
explode = Explode(Curve=sheet_outline, Recursive=True)  # -> simplify(graft(Segments)), Vertices
explode_2 = Explode(Curve=offset_2, Recursive=True)  # -> simplify(graft(Segments)), Vertices
loft = Loft(
    Curves=[explode_2.Segments, explode.Segments],
    Options={Adjust=False, Closed=False, LoftEnds=0, LoftSimp=0, LoftType=0, Rebuild=10, Refit=0.01})
polyboolean_2 = PolylineBoolean(
    A=loft,
    B=polyboolean,
    BooleanType=0,
    Plane=Plane(origin=(0, 0, 0), x=(0, 0, 0), y=(0, 0, 0)),
    Tolerance=0.01,
    EvenOdd=True)
boundary = BoundarySurfaces(Edges=polyboolean_2)  # -> graft(Surfaces)
debrep = DeconstructBrep(Brep=simplify(boundary))  # -> Faces, Edges, Vertices
join = JoinCurves(Curves=debrep.Edges, Preserve=False)  # -> simplify(Curves)
addition = Addition(A=offset, B=min_width)
polyoffset = PolylineOffset(
    Polylines=join,
    Distance=addition,
    Plane=Plane(origin=(0, 0, 0), x=(0, 0, 0), y=(0, 0, 0)),
    Tolerance=0.01,
    ClosedFillet=cf,
    OpenFillet=1,
    Miter=addition)  # -> Contour, Holes
crv = Curve(simplify(polyoffset.Holes))
number_slider = Slider(0.01, range=0..0.01)
end = EndPoints(Curve=crv)  # -> Start, End
srf_cp = SurfaceClosestPoint(Point=end.Start, Surface=boundary)  # -> Point, UVPoint, Distance
smaller = SmallerThan(FirstNumber=srf_cp.Distance, SecondNumber=number_slider)  # -> SmallerThan, OrEqualTo
cull = CullPattern(List=crv, CullPattern=smaller.SmallerThan)
addition_2 = Addition(A=offset, B=number_slider)
xy = XYPlane(Origin=Point(0, 0, 0))

polyoffset_2 = PolylineOffset(
    Polylines=cull,
    Distance=min_width,
    Plane=Plane(origin=(0, 0, 0), x=(0, 0, 0), y=(0, 0, 0)),
    Tolerance=0.01,
    ClosedFillet=cf_2,
    OpenFillet=1,
    Miter=2)  # -> Contour, Holes
crv_2 = Curve(simplify(polyoffset_2.Contour))

explode_3 = Explode(Curve=crv_2, Recursive=True)  # -> Segments, Vertices
pull = PullPoint(Point=explode_3.Vertices, Geometry=sheet_outline, ClosestOnly=True)  # -> ClosestPoint, Distance
smaller_2 = SmallerThan(FirstNumber=pull.Distance, SecondNumber=addition_2)  # -> SmallerThan, OrEqualTo
sift = SiftPattern(List=explode_3.Vertices, SiftPattern=smaller_2.OrEqualTo)  # -> Output0, Output1
sift_2 = SiftPattern(List=pull.ClosestPoint, SiftPattern=smaller_2.OrEqualTo)  # -> Output0, Output1
combine = CombineData(Input0=sift.Output0, Input1=sift_2.Output1)  # -> Result, Index
pline = PolyLine(Vertices=combine.Result, Closed=invert(False))
trim = TrimTree(Tree=pline, Depth=1)
crv_3 = Curve(simplify(trim))
crvprox = CurveProximity(CurveA=sheet_outline, CurveB=crv_3)  # -> PointA, PointB, Distance
smaller_3 = SmallerThan(FirstNumber=crvprox.Distance, SecondNumber=0.01)  # -> SmallerThan, OrEqualTo
cull_2 = CullPattern(List=crv_3, CullPattern=smaller_3.SmallerThan)
explode_4 = Explode(Curve=cull_2, Recursive=True)  # -> Segments, simplify(Vertices)
pull_2 = PullPoint(Point=explode_4.Vertices, Geometry=sheet_outline, ClosestOnly=True)  # -> ClosestPoint, Distance
smaller_4 = SmallerThan(FirstNumber=pull_2.Distance, SecondNumber=number_slider)  # -> SmallerThan, OrEqualTo
cull_3 = CullPattern(List=pull_2.ClosestPoint, CullPattern=smaller_4.SmallerThan)
bbox = BoundingBox(Content=cull_3, Plane=PlaneXY(0, 0, 0), UnionBox=True)  # -> Box, Box_2
boxprop = BoxProperties(Box=bbox.Box)  # -> Center, Diagonal, Area, Volume, Degeneracy
dist = Distance(PointA=xy, PointB=boxprop.Diagonal)
larger = LargerThan(FirstNumber=dist, SecondNumber=min_length)  # -> LargerThan, OrEqualTo
trim_2 = TrimTree(Tree=larger.OrEqualTo, Depth=1)
cull_4 = CullPattern(List=simplify(cull_2), CullPattern=trim_2)

L = ClusterOutput(cull_4)

# ==== cluster Footprint
G = ClusterInput()
graft = GraftTree(Tree=G, IncludeEmptyLists=True, IncludeNullItems=True)

md_slider = MDSlider(SliderMode=0, slider_value=Point(0.5, 0.5, 0.5), x_domain=Domain(0, 1), y_domain=Domain(0, 1), z_domain=Domain(0, 1))
debrep = DeconstructBrep(Brep=graft)  # -> Faces, Edges, Vertices
evalsrf = EvaluateSurface(Surface=reparameterize(debrep.Faces), Point=md_slider)  # -> Point, Normal, UDirection, VDirection, Frame
Z = UnitZ(Factor=1)
dprod = DotProduct(VectorA=evalsrf.Normal, VectorB=Z, Unitize=invert(False))
larger = LargerThan(FirstNumber=dprod, SecondNumber="0.001")  # -> LargerThan, OrEqualTo
cull = CullPattern(List=debrep.Faces, CullPattern=larger.LargerThan)
project = Project(Geometry=cull, Plane=PlaneXY(0, 0, 0))  # -> Geometry, Transform

edges = BrepEdges(Brep=project.Geometry)  # -> Naked, Interior, NonManifold
number_slider = Slider(10, range=0..10)
join = JoinCurves(Curves=edges.Naked, Preserve=False)
trim = TrimTree(Tree=join, Depth="3")
polyoffset = PolylineOffset(
    Polylines=trim,
    Distance=number_slider,
    Plane=Plane(origin=(0, 0, 0), x=(0, 0, 0), y=(0, 0, 0)),
    Tolerance=0.001,
    ClosedFillet=2,
    OpenFillet=2,
    Miter=2)  # -> Contour, Holes
crv = Curve(polyoffset.Contour)
item = ListItem(List=crv, Index=0, Wrap=True)
clean = CleanTree(RemoveNulls=True, RemoveInvalid=True, RemoveEmpty=False, Tree=item)
polyoffset_2 = PolylineOffset(
    Polylines=clean,
    Distance=number_slider,
    Plane=Plane(origin=(0, 0, 0), x=(0, 0, 0), y=(0, 0, 0)),
    Tolerance=0.001,
    ClosedFillet=2,
    OpenFillet=2,
    Miter=2)  # -> Contour, Holes
panel = Panel(clean)
crv_2 = Curve(polyoffset_2.Holes)
item_2 = ListItem(List=crv_2, Index=0, Wrap=True)
trim_2 = TrimTree(Tree=item_2, Depth="3")
panel_2 = Panel(trim_2)
match = MatchTree(Tree=trim_2, Guide=G)
footprint = ClusterOutput(match)
